# Grasshopper definition vectors_002.gh (Grasshopper 1.0.7)
# Copyright: bernhard muller bijoutiers
# plug-ins: Workshop

# CHEATSHEET - Rhino Script Syntax
# WICKERSON STUDIOS
# SUBSCRIBE TO PATREON:
# https://www.patreon.com/MichaelWickerson?fan_landing=true
wickerson_s_first_grasshopper_component = WickersonsFirstGrasshopperComponent()

# ---- group: rs.GetString()
ghpython_script = GhPythonScript()  # -> out, a; disabled
# ---------- ghpython_script: Python ----------
import rhinoscriptsyntax as rs

a = rs.CurrentLayer()
a = rs.GetString("Layer to set current", a)
if a: 
    rs.CurrentLayer(a)
# ---------- end ghpython_script ----------

# ---- group: rs.VectorAngle()
ghpython_script_2 = GhPythonScript()  # -> out, a, b; disabled
# ---------- ghpython_script_2: Python ----------
#dependent on rs.GetObject with rs.filter.surface
#dependent on rs.SurfaceDomain
#dependent on rs.SurfaceNormal

import rhinoscriptsyntax as rs
s0 = rs.GetObject("Surface 0", rs.filter.surface)
s1 = rs.GetObject("Surface 1", rs.filter.surface)
du0 = rs.SurfaceDomain(s0, 0)
dv0 = rs.SurfaceDomain(s0, 1)
du1 = rs.SurfaceDomain(s1, 0)
dv1 = rs.SurfaceDomain(s1, 1)
n0 = rs.SurfaceNormal(s0, (du0[0], dv0[0]))
n1 = rs.SurfaceNormal(s1, (du1[0], dv1[0]))
a = rs.VectorAngle(n0, n1)
b = rs.VectorAngle(n0, rs.VectorReverse(n1))
print a
print b
# ---------- end ghpython_script_2 ----------

# ---- group: rs.VectoLength()
ghpython_script_3 = GhPythonScript()  # -> Out, A

# ---- group: rs.VectorCreate()
ghpython_script_4 = GhPythonScript()  # -> Out, A

# ---- group: rs.VectorScale()
ghpython_script_5 = GhPythonScript()  # -> Out, A

# ----
# point, line, surface, geometry
# rs.AddPoint()
# rs.AddPoints()
# rs.AddSrfPt()
# rs.AddLine()
# rs.AddCurve()
# rs.AddCircle()
# rs.AddRectangle()
# rs.AddPlanarSrf()
# rs.AddEllipse()
# rs.AddBox()
# rs.AddCone()
# rs.AddSweep1()
# rs.AddSweep2()
ghpython_script_6 = GhPythonScript()  # -> Out, A

# ----
# Transfomations
# rs.RotateObject()
# rs.ScaleObject()
# rs.MoveObjectt()
# rs.MirrorObject()
ghpython_script_7 = GhPythonScript()  # -> Out, A

# ----
# Miscellaneous
# rs.ExtendCurve()
# rs.AddLoftSrf()
# rs.OffsetCurve()
# rs.OffsetSurface()
# rs.ExtrudeSurface()
# rs.AddTextDot()
# rs.ObjectColor()
# rs.CopyObject()
# rs.DeleteObject()
# rs.HideObject()
# rs.EnableRedraw()
# rs.CurvePrepFrame()
# rs.WorldXYPlane()
# rs.ReverseCurve()
# rs.RebuildSurface()
# rs.JoinCurves()
ghpython_script_8 = GhPythonScript()  # -> Out, A

# ----
# Line, Curve, Surface Evaluation
# rs.Distance()
# rs.DivideCurve()
# rs.CurveMidPoint()
# rs.CurveAreaCentroid()
# rs.CurveStartPoint()
# rs.CurveEndPoint()
# rs.CurveClosestPoint()
# rs.CurveDomain()
# rs.BrepClosestPoint()
# rs.PointClosestPoint()
# rs.CurveDomain()
# rs.SurfaceDomain()
# rs.SurfaceNormal()
# rs.SurfaceAreaCentroid()
# rs.EvaluateSurface()
# rs.PlaneFromNormal()
# rs.DistanceToPlane()
# rs.PlaneFromPlane()
ghpython_script_9 = GhPythonScript()  # -> Out, A

# ----
# Selection and Input
# rs.GetString()
# rs.GetInteger()
# rs.GetReal()
# rs.GetObject()
# rs.GetObjects()
# rs.PointCoordinates()
panel = Panel("1234567890")  # disabled
panel_2 = Panel("1234567890")  # disabled
panel_3 = Panel("1234567890")  # disabled
panel_4 = Panel("Wickerson Studios Kicks Butt!")  # disabled
panel_5 = Panel("1234567890")  # disabled
panel_6 = Panel("1234567890")  # disabled
panel_7 = Panel(ghpython_script.a)  # disabled

# ---- group: rs.GetString()
ghpython_script_10 = GhPythonScript(x=panel_4)  # -> out, a; disabled
# ---------- ghpython_script_10: Python ----------
import rhinoscriptsyntax as rs

print x
a = rs.GetString(message="Enter a string", defaultString="Wickerson Studios", strings="Wickerson")
# ---------- end ghpython_script_10 ----------

# ---- group: rs.GetInteger()
ghpython_script_11 = GhPythonScript(x=panel)  # -> out, a; inputs x: Int32; disabled
# ---------- ghpython_script_11: Python ----------
import rhinoscriptsyntax as rs

print x

a = rs.GetInteger(message="Enter an integer.", number=123, minimum=100, maximum=256)
# ---------- end ghpython_script_11 ----------

# ---- group: rs.GetReal()
ghpython_script_12 = GhPythonScript(x=panel_5)  # -> out, a; inputs x: Int32; disabled
# ---------- ghpython_script_12: Python ----------
import rhinoscriptsyntax as rs

print x
a = rs.GetReal(message="Number", number=777, minimum=3, maximum=120)
# ---------- end ghpython_script_12 ----------

# ---- group: rs.GetObject
ghpython_script_13 = GhPythonScript(x=panel_2)  # -> out, a; inputs x: Int32; disabled
# ---------- ghpython_script_13: Python ----------
import rhinoscriptsyntax as rs

print x
import rhinoscriptsyntax as rs

a = rs.GetObject("Pick any object")
if a:
    print "Object identifier: ", a
"""
a = rs.GetObject("Pick a curve or surface", rs.filter.curve | rs.filter.surface)

if a:
    print "Object identifier: ", a
"""
# ---------- end ghpython_script_13 ----------

# ---- group: rs.GetObjects
ghpython_script_14 = GhPythonScript(x=panel_6)  # -> out, a; inputs x: Int32; disabled
# ---------- ghpython_script_14: Python ----------
print x

import rhinoscriptsyntax as rs

a = []
objectIds = rs.GetObjects("Pick some surfaces", rs.filter.surface)
for id in objectIds: 
    print "Object identifier:", id
    a.append(id)
# ---------- end ghpython_script_14 ----------

# ---- group: rs.PointCoordinates()
ghpython_script_15 = GhPythonScript(x=panel_3)  # -> out, a; inputs x: Int32; disabled
# ---------- ghpython_script_15: Python ----------
print x

import rhinoscriptsyntax as rs

a = rs.GetObject("Select point", rs.filter.point)
point = rs.PointCoordinates(a)
if point: 
    print point
# ---------- end ghpython_script_15 ----------

# ----
panel_8 = Panel(ghpython_script_14.out)  # disabled
panel_9 = Panel(ghpython_script_13.out)  # disabled
panel_10 = Panel(ghpython_script_10.out)  # disabled
panel_11 = Panel(ghpython_script_11.a)  # disabled
panel_12 = Panel(ghpython_script_12.a)  # disabled
panel_13 = Panel(ghpython_script_10.a)  # disabled
panel_14 = Panel(ghpython_script_11.out)  # disabled
panel_15 = Panel(ghpython_script_12.out)  # disabled
panel_16 = Panel(ghpython_script_13.a)  # disabled
panel_17 = Panel(ghpython_script_14.a)  # disabled
panel_18 = Panel(ghpython_script_15.out)  # disabled
panel_19 = Panel(ghpython_script_15.a)  # disabled

# ----
# vectors
# rs.AddPoint()
# rs.VectorCreate()
# rs.VectorUnitize()
# rs.VectorAngle()
# rs.VectorScale()
# rs.VectorLength()
number_slider = Slider(1.61, range=-2..2)  # disabled
number_slider_2 = Slider(2, range=0..10)  # disabled
number_slider_3 = Slider(2, range=0..10)  # disabled
number_slider_4 = Slider(2, range=0..10)  # disabled
number_slider_5 = Slider(-0.84, range=-2..2)  # disabled
number_slider_6 = Slider(0.28, range=-2..2)  # disabled
number_slider_7 = Slider(1.88, range=0..10)  # disabled
number_slider_8 = Slider(2.09, range=0..10)  # disabled
number_slider_9 = Slider(2.09, range=0..10)  # disabled
number_slider_10 = Slider(1.94, range=0..10)  # disabled
number_slider_11 = Slider(1.94, range=0..10)  # disabled
number_slider_12 = Slider(2.09, range=0..10)  # disabled
number_slider_13 = Slider(6.23, range=0..10)  # disabled
number_slider_14 = Slider(1.59, range=0..10)  # disabled
number_slider_15 = Slider(4.07, range=0..10)  # disabled
number_slider_16 = Slider(42, range=0..100)  # disabled
panel_20 = Panel(ghpython_script_2.out)  # disabled
panel_21 = Panel(ghpython_script_2.a)  # disabled
panel_22 = Panel(ghpython_script_2.b)  # disabled
number_slider_17 = Slider(42, range=0..100)  # disabled

# ---- group: rs.VectorCreate()
ghpython_script_16 = GhPythonScript(
    x=number_slider_10,
    y=number_slider_11,
    z=number_slider_7,
    deltaX=number_slider_12,
    deltaY=number_slider_8,
    deltaZ=number_slider_9)  # -> out, rhino_vector, ghpython_vector; disabled
# ---------- ghpython_script_16: Python ----------
import rhinoscriptsyntax as rs

point1 = rs.GetPoint("First point")
point2 = rs.GetPoint("Next point")
rhino_vector = rs.VectorCreate(point2, point1)
print rhino_vector

point3 = rs.AddPoint(x,y,z)
point4 = rs.AddPoint(deltaX, deltaY,deltaZ)
ghpython_vector = rs.VectorCreate(point3, point4)
print ghpython_vector
# ---------- end ghpython_script_16 ----------

# ---- group: rs.AddPoint()
ghpython_script_17 = GhPythonScript(
    x=number_slider_2,
    y=number_slider_3,
    z=number_slider_4,
    multX=number_slider,
    multY=number_slider_5,
    multZ=number_slider_6)  # -> out, point_out; inputs x: Int32, y: Int32, z: Int32; disabled
# ---------- ghpython_script_17: Python ----------
import rhinoscriptsyntax as rs

point1 = (x,y,z)
point2 = (multX*x,multY*y,multZ*z)
point = rs.PointAdd(point1, point2)
print point

point_out = point
# ---------- end ghpython_script_17 ----------

# ---- group: rs.VectorUnitize()
ghpython_script_18 = GhPythonScript(x=number_slider_13, y=number_slider_14, z=number_slider_15)  # -> out, vector; disabled
# ---------- ghpython_script_18: Python ----------
import rhinoscriptsyntax as rs
vector = rs.VectorUnitize( [x,y,z] )
print vector
# ---------- end ghpython_script_18 ----------

# ----
vector = Vector(ghpython_script_18.vector)  # disabled
panel_23 = Panel(ghpython_script_17.point_out)  # disabled
panel_24 = Panel(ghpython_script_17.out)  # disabled
vector_2 = Vector(ghpython_script_16.ghpython_vector)  # disabled
vector_3 = Vector(ghpython_script_16.rhino_vector)  # disabled
amplitude = Amplitude(Vector=vector, Amplitude=number_slider_16)  # disabled
vector_display = VectorDisplay(Anchor=vector, Vector=amplitude)  # disabled
amplitude_2 = Amplitude(Vector=vector_3, Amplitude=number_slider_17)  # disabled
amplitude_3 = Amplitude(Vector=vector_2, Amplitude=number_slider_17)  # disabled
vector_display_2 = VectorDisplay(Anchor=vector_2, Vector=amplitude_3)  # disabled
vector_display_3 = VectorDisplay(Anchor=vector_3, Vector=amplitude_2)  # disabled
